# Dynamo graph DynaWeb_YourDesk_REST.dyn "DynaWeb_YourDesk_Example" (Dynamo 2.10.1.3976)
# packages: DynaWeb 1.0.3

# group: Get all Walls
string = StringInput("https://yourdesk-rest.vercel.app/walls/")
byUrl = DynaWeb.WebRequest.ByUrl(url=string)
execute = DynaWeb.WebRequest.Execute(request=byUrl)  # frozen
content = DynaWeb.WebResponse.Content(webResponse=execute)
deserialise = DynaWeb.Helpers.Deserialise(json=content)

select_walls = DSModelElementSelection()  # 1 picked in the model

# group: Property Extraction From Elements
id = Element.Id(element=select_walls)
name = Element.Name(element=select_walls)
string_2 = StringInput("Length")
getParameterValueByName = Element.GetParameterValueByName(element=select_walls, parameterName=string_2)
string_3 = StringInput("Unconnected Height")
getParameterValueByName_2 = Element.GetParameterValueByName(element=select_walls, parameterName=string_3)
parameters = Element.Parameters(element=select_walls)

just_for_readability = CodeBlock(id=id, name=name, length=getParameterValueByName, volume=getParameterValueByName_2) { id; name; length; volume; }

# group: String Concatenation to form as a webrequest as I dont know DynaWeb good enough :)
string_4 = StringInput("https://yourdesk-rest.vercel.app/walls?id=")
string_from_object = FromObject(object=just_for_readability.id)
code_block = CodeBlock { "&name="; "&length="; "&volume="; }
string_from_object_2 = FromObject(object=just_for_readability.length)
string_from_object_3 = FromObject(object=just_for_readability.volume)
concat = String.Concat(string0=string_4, string1=string_from_object, string2=code_block.out0, string3=just_for_readability.name, string4=code_block.out1, string5=string_from_object_2, string6=code_block.out2, string7=string_from_object_3)

watch = Watch(concat)

# group: Web Request
byUrl_2 = DynaWeb.WebRequest.ByUrl(url=concat)
string_5 = StringInput("POST")
setMethod = DynaWeb.WebRequest.SetMethod(webRequest=byUrl_2, method=string_5)
execute_2 = DynaWeb.WebRequest.Execute(request=setMethod)  # frozen
content_2 = DynaWeb.WebResponse.Content(webResponse=execute_2)

# group: Simple Check if its Working
string_6 = StringInput("https://yourdesk-rest.vercel.app/")
byUrl_3 = DynaWeb.WebRequest.ByUrl(url=string_6)
execute_3 = DynaWeb.WebRequest.Execute(request=byUrl_3)
content_3 = DynaWeb.WebResponse.Content(webResponse=execute_3)  # frozen

watch_2 = Watch(content_3)
